# Grasshopper definition TimeBasedGcode.gh (Grasshopper 1.0.7)

# ---- group: sample
number_slider = Slider(0.5, range=0..1)
number_slider_2 = Slider(150, range=0..100000)
multiplication = Multiplication(A=Slider(0.8, range=0..1), B=number_slider)
series = Series(Start=multiplication, Step=number_slider, Count=Slider(50, range=0..100))
division = Division(A=number_slider_2, B=2)
neg = Negative(Value=division)
rectangle = Rectangle(Plane=PlaneXY(0, 0, 0), XSize=number_slider_2, YSize=number_slider_2, Radius=0)  # -> Rectangle, Length
vec = VectorXYZ(XComponent=neg, YComponent=neg, ZComponent=series)  # -> Vector, Length
move = Move(Geometry=rectangle.Rectangle, Motion=vec.Vector)  # -> Geometry, Transform
end = EndPoints(Curve=move.Geometry)  # -> Start, End
shift = ShiftList(List=end.Start, Shift=1, Wrap=True)
ln = Line(StartPoint=end.Start, EndPoint=shift)
cull_i = CullIndex(List=ln, Indices=-1, Wrap=True)
weave = Weave(Pattern=[0, 1], Stream0=move.Geometry, Stream1=cull_i, NullGaps=False)

# ---- group: list of curves
crv = Curve(weave)

# ----
clean = CleanTree(RemoveNulls=True, RemoveInvalid=True, RemoveEmpty=True, Tree=crv)

# ---- group: move speed(mm/min)
number_slider_3 = Slider(1000, range=0..10000)

# ----
panel = Panel("mm/0.1sec")
division_2 = Division(A=number_slider_3, B="600")

# ---- group: スタート地点への移動と分割
end_2 = EndPoints(Curve=clean)  # -> Start, End
pt = ConstructPoint(XCoordinate=0, YCoordinate=0, ZCoordinate=Slider(5, range=0..10))
item = ListItem(List=flatten(end_2.Start), Index=0, Wrap=True)
pt_2 = Point(pt)
ln_2 = Line(StartPoint=pt_2, EndPoint=item)
merge = Merge(Data1=ln_2)
end_3 = EndPoints(Curve=merge)  # -> Start, graft(End)
divdist = DivideDistance(Curve=merge, Distance=division_2)  # -> Points, Tangents, Parameters
merge_2 = Merge(Data1=divdist.Points, Data2=end_3.End)
bang = ExplodeTree(Data=merge_2)  # -> Branch0, Branch1
lng = ListLength(List=bang.Branch0)

# ----
end_4 = EndPoints(Curve=clean)  # -> Start, graft(End)
divdist_2 = DivideDistance(Curve=clean, Distance=division_2)  # -> simplify(Points), Tangents, Parameters
merge_3 = Merge(Data1=simplify(divdist_2.Points), Data2=simplify(end_4.End))
panel_2 = Panel("""True
False""")
flip = FlipMatrix(Data=divdist_2.Points)
cull = CullPattern(List=flip, CullPattern=panel_2)
flip_2 = FlipMatrix(Data=cull)
item_2 = ListItem(List=flip_2, Index=0, Wrap=True)
pt_3 = Point(flatten(merge_3))
merge_4 = Merge(Data1=flatten(merge_2), Data2=flatten(pt_3))

# ---- group: extrusion speed
number_slider_4 = Slider(100, range=0..500)

# ----
dup = DuplicateData(Data=Slider(0, range=0..100), Number=lng, Order=True)
end_gcode = Panel(""";;;
M104 S0 ; turn off extruder
M140 S0 ; turn off bed
G91 ; Set to Relative Positioning
G1 Z10 ; Move up nozzle
G90 ; Set to Absolute Positioning
M84 ; disable motors
M81 ; ATX Power Off""")
start_gcode = Panel("""G90 ; Set to Absolute Positioning
G1 F2000 ; set moving speed
G28 ; home all axes
G29 ; run auto bed leveling routine
M109 S none ; heat the extruder
M190 S none ; heat the bed
G92 E0 ; reset extrusion distance
;;;""")

# ---- group: export path
path = FilePath("/Users/neguse/Desktop/")

# ---- group: export
button = Button()

# ---- group: file name
panel_3 = Panel("print-f.gcode")

# ---- group: points distance
lng_2 = ListLength(List=pt_3)

# ----
subtraction = Subtraction(A=lng_2, B=1)

# ---- group: points distance (continued)
series_2 = Series(Start=0, Step=1, Count=subtraction)
item_3 = ListItem(List=pt_3, Index=series_2, Wrap=True)  # -> Item, Item1
dist = Distance(PointA=item_3.Item, PointB=item_3.Item1)

# ----
bnd = Bounds(Numbers=dist)
dedomain = DeconstructDomain(Domain=bnd)  # -> Start, End
division_3 = Division(A=dist, B=dedomain.End)
dup_2 = DuplicateData(Data=number_slider_4, Number=lng_2, Order=True)  # -> flatten(Data)
multiplication_2 = Multiplication(A=dup_2, B=division_3)
merge_5 = Merge(Data1=flatten(dup), Data2=flatten(multiplication_2))
python = PythonScript(
    Points=flatten(merge_4),
    Extrude=flatten(merge_5),
    List_Length=flatten(lng_2),
    speed=number_slider_3,
    layer_start_points=flatten(item_2),
    bool=True)  # -> flatten(Gcode), flatten(test); inputs Points: list of Point3d, Extrude: list of Int32, List_Length: list, layer_start_points: list of Point3d, bool: Boolean
# ---------- python: Python ----------
__author__ = "neguse"

import rhinoscriptsyntax as rs


if bool:
    Gcode = []

    for i in range(len(Points)):
        x = round(Points[i].X,2)
        y = round(Points[i].Y,2)
        z = 1*round(Points[i].Z,2)
        
        '''
        #レイヤー最初の一歩
        for t in layer_start_points:
            if t.X == Points[i].X and t.Y == Points[i].Y and t.Z == Points[i].Z:
                Gcode.append("M915 D90 Z0".format())
        '''
        
        #通常吐出
        if Extrude[i] != 0:
            Gcode.append("G1 X{} Y{} Z{} E{}".format(x,y,z,Extrude[i]))
        
        #最初の一歩
        elif i == 0:
            Gcode.append("G1 X{} Y{} Z{}".format(x,y,z))
            Gcode.append("G1 F{}".format(speed))
        
        #吐出なし
        else:
            Gcode.append("G1 X{} Y{} Z{}".format(x,y,z))

        test = Extrude[0]
# ---------- end python ----------
merge_6 = Merge(Data1=flatten(start_gcode), Data2=flatten(python.Gcode), Data3=flatten(end_gcode))
python_2 = PythonScript(FileName=panel_3, Gcode=merge_6, Path=path, bool=button)  # inputs Gcode: list
# ---------- python_2: Python ----------
__author__ = "neguse"

import rhinoscriptsyntax as rs

Gcode ='\n'.join(Gcode)

if bool:
	file = open(Path + FileName, 'w')
	file.writelines(Gcode)
	file.close()
# ---------- end python_2 ----------
